# Grasshopper definition ProcedualNeighborhood.ghx (Grasshopper 1.0.8)

c_script = CSharpScript(NSamples="1000", NVariables="7", seed="4", all=Toggle(True))  # -> out, All, Iter; inputs NSamples: Int32, NVariables: Int32, seed: Int32, all: Boolean, iter: Int32
# ---------- c_script: C# ----------
// Grasshopper Script Instance
#region Usings
using System;
using System.Linq;
using System.Collections;
using System.Collections.Generic;
using System.Drawing;

using Rhino;
using Rhino.Geometry;

using Grasshopper;
using Grasshopper.Kernel;
using Grasshopper.Kernel.Data;
using Grasshopper.Kernel.Types;
#endregion

public class Script_Instance : GH_ScriptInstance
{
    #region Notes
    /* 
      Members:
        RhinoDoc RhinoDocument
        GH_Document GrasshopperDocument
        IGH_Component Component
        int Iteration

      Methods (Virtual & overridable):
        Print(string text)
        Print(string format, params object[] args)
        Reflect(object obj)
        Reflect(object obj, string method_name)
    */
    #endregion

    private void RunScript(
		int NSamples,
		int NVariables,
		int seed,
		bool all,
		int iter,
		ref object All,
		ref object Iter)
    {
          //run for the first time
    if(r == null) {
      _NSamples = NSamples;
      _NVariables = NVariables;
      _Seed = seed;

      r = new Random(seed);
      inputs = new DataTree<double>();
      matrix = RandLatinHypercube(NSamples, NVariables);
      for (int i = 0; i < NSamples; i++)
      {
        var row = GetRow(matrix, i);
        inputs.AddRange(row, new GH_Path(i));
      }
    }
      //sampling inputs changed
    else{
      if(NSamples != _NSamples || _NVariables != NVariables || _Seed != seed){
        _NSamples = NSamples;
        _NVariables = NVariables;
        _Seed = seed;

        r = new Random(seed);
        inputs = new DataTree<double>();
        matrix = RandLatinHypercube(NSamples, NVariables);
        for (int i = 0; i < NSamples; i++)
        {
          var row = GetRow(matrix, i);
          inputs.AddRange(row, new GH_Path(i));
        }
      }
    }



    // just in case this gets too heavy for the canvas
    if(all){  All = inputs; }


    //List<double> vals = new List<double>();
    //foreach(var b in inputs.Branches){
      //vals.Add(b[iter]);
    //}

    Iter = inputs.Branches[iter];
    }


    int _NSamples;
  int _NVariables;
  int _Seed;
  Random r ;
  DataTree<double> inputs;
  double[,] matrix;


  double[,] RandLatinHypercube(int n, int k)
  {
    double[,] X = new double[n, k];
    for (int i = 0; i < k; i++)
    {
      double[] v = new double[n];

      for (int j = 0; j < n; j++)
      {
        v[j] = j;
      }
      v = this.Shuffle(v);

      //SetColumn;
      for (int j = 0; j < n; j++)
      {
        X[j, i] = v[j];
      }
    }

    double[,] array1 = new double[n, k];
    double[,] array2 = new double[n, k];

    for (int i = 0; i < n; i++)
    {
      for (int j = 0; j < k; j++)
      {
        array1[i, j] = 0.5;
        array2[i, j] = n;
      }
    }

    //Add
    for (int i = 0; i < n; i++)
    {
      for (int j = 0; j < k; j++)
      {
        X[i, j] = X[i, j] + array1[i, j];
      }
    }

    //PointwiseDivide
    for (int i = 0; i < n; i++)
    {
      for (int j = 0; j < k; j++)
      {
        X[i, j] = X[i, j] / array2[i, j];
      }
    }
    return X;
  }


  private double[] Shuffle(double[] v)
  {
    int n = v.Length;
    while (n > 1)
    {
      n--;
      int k = r.Next(n + 1);
      double value = v[k];
      v[k] = v[n];
      v[n] = value;
    }
    return v;
  }


  public static T[] GetCol<T>(T[,] matrix, int col)
  {
  var rows = matrix.GetLength(0);
  var array = new T[rows];
  for (int i = 0; i < rows; ++i)
  array[i] = matrix[ i, col];
  return array;
}


public static T[] GetRow<T>(T[,] matrix, int row)
  {
  var columns = matrix.GetLength(1);
var array = new T[columns];
for (int i = 0; i < columns; ++i)
array[i] = matrix[row, i];
  return array;
}
}
# ---------- end c_script ----------
height = Panel("3")
height_2 = Panel("15")
heightvar = Panel("0.2")
heightvar_2 = Panel("0.8")
type = Panel("0")
type_2 = Panel("3")
bldgdepth = Panel("10")
bldgdepth_2 = Panel("20")
streetdim = Panel("10")
xydim = Panel("20")
xydim_2 = Panel("60")
streetdim_2 = Panel("30")
rot = Panel("0")
rot_2 = Panel("90")
dom = ConstructDomain(DomainStart=heightvar, DomainEnd=heightvar_2)
dom_2 = ConstructDomain(DomainStart=height, DomainEnd=height_2)
dom_3 = ConstructDomain(DomainStart=type, DomainEnd=type_2)
dom_4 = ConstructDomain(DomainStart=bldgdepth, DomainEnd=bldgdepth_2)
dom_5 = ConstructDomain(DomainStart=streetdim, DomainEnd=streetdim_2)
dom_6 = ConstructDomain(DomainStart=xydim, DomainEnd=xydim_2)
dom_7 = ConstructDomain(DomainStart=rot, DomainEnd=rot_2)
pt = Point(Point(-0.008008612246, -0.02678915199, 0))
floorheight = Panel("3.5")
number_slider = Slider(469, range=400..800)
addition = Addition(A=number_slider, B="5")
path = ConstructPath(Indices=number_slider)
branch = TreeBranch(Tree=c_script.All, Path=path, MaintainPaths=True)
explode_tree = ExplodeTree(Data=graft(branch))  # -> Branch0, Branch1, Branch2, Branch3, Branch4, Branch5, Branch6
remap = RemapNumbers(Value=explode_tree.Branch4, Source=Domain(0, 1), Target=dom)  # -> Mapped, Clipped
remap_2 = RemapNumbers(Value=explode_tree.Branch6, Source=Domain(0, 1), Target=dom_4)  # -> Mapped, Clipped
remap_3 = RemapNumbers(Value=explode_tree.Branch1, Source=Domain(0, 1), Target=dom_5)  # -> Mapped, Clipped
remap_4 = RemapNumbers(Value=explode_tree.Branch0, Source=Domain(0, 1), Target=dom_6)  # -> Mapped, Clipped
remap_5 = RemapNumbers(Value=explode_tree.Branch1, Source=Domain(0, 1), Target=dom_6)  # -> Mapped, Clipped
remap_6 = RemapNumbers(Value=explode_tree.Branch2, Source=Domain(0, 1), Target=dom_7)  # -> Mapped, Clipped
hrandlower = Number(remap.Mapped)
hrandseed = Number(explode_tree.Branch4)
bldgdepth_3 = Number(remap_2.Mapped)
streetdim_3 = Number(remap_3.Mapped)
rotation = Number(remap_6.Mapped)
xdim = Number(remap_4.Mapped)
ydim = Number(remap_5.Mapped)
hrandlower_2 = Number(hrandlower)
streetdim_4 = Number(streetdim_3)
hrandseed_2 = Number(hrandseed)
xdim_2 = Number(xdim)
ydim_2 = Number(ydim)
rotation_2 = Number(rotation)
bldgdepth_4 = Number(bldgdepth_3)
data = Data(remap_3.Mapped)
data_2 = Data(remap_5.Mapped)
rectanglegen = RectangleGen(O=pt, num_2=xdim_2, num=ydim_2)
multiplication = Multiplication(A=data, B="0.5")
addition_2 = Addition(A=data_2, B=multiplication)
Y = UnitY(Factor=addition_2)
move = Move(Geometry=rectanglegen, Motion=Y)  # -> Geometry, Transform
cluster = Cluster_2(blkdim="300", edgedim=ydim_2, streetdim=streetdim_4)
copygen = CopyGen(blkdim="300", edgedim=xdim_2, streetdim=streetdim_4)
x_dir = UnitX(Factor=copygen)
Y_2 = UnitY(Factor=cluster)
cluster_2 = Cluster(rectbase=move.Geometry, xdir=x_dir, ydir=Y_2)
lng = ListLength(List=cluster_2)
random = Random(Range=Domain(0, 1), Number=lng, Seed=number_slider)
random_2 = Random(Range=Domain(0, 1), Number=lng, Seed=number_slider)
random_3 = Random(Range=Domain(0, 1), Number=lng, Seed=number_slider)
panel = Panel(lng)
remap_7 = RemapNumbers(Value=random_3, Source=Domain(0, 1), Target=dom_3)  # -> Mapped, Clipped
remap_8 = RemapNumbers(Value=random_2, Source=Domain(0, 1), Target=dom_2)  # -> Mapped, Clipped
cluster_3 = Cluster_5(C=panel)
int = Integer(remap_7.Mapped)
int_2 = Integer(remap_8.Mapped)
multiplication_2 = Multiplication(A=int_2, B=floorheight)
multiplication_3 = Multiplication(A=multiplication_2, B=random)
addition_3 = Addition(A=multiplication_2, B=multiplication_3)
bldg_type_l_c_o = BLDGTypeLCO(
    origin=pt,
    xdim=xdim_2,
    ydim=ydim_2,
    xdim2=Slider(1, range=0..1),
    ydim2=Slider(0.5, range=0..1),
    xshift=Slider(1, range=0..1),
    yshift=Slider(0, range=0..1),
    heigh=multiplication_2,
    radius=cluster_3)  # -> flatten(bldg_2)
bldg_type_box = BLDGTypeBox(origin=pt, xdim=xdim_2, ydim=ydim_2, height=multiplication_2, radius=cluster_3)  # -> flatten(bldg_2)
bldg_type_courtyard = BLDGTypeCourtyard(origin=pt, xdim=xdim_2, ydim=ydim_2, height=multiplication_2, depth=bldgdepth_4, radius=cluster_3)  # -> flatten(B)
bldg_type_towerbase = BLDGTypeTowerBase(
    origin=pt,
    xdim=xdim_2,
    ydim=ydim_2,
    xdimtop1=Slider(0.6, range=0..1),
    xdimtop2=Slider(0.2, range=0..1),
    ydimtop1=Slider(0.7, range=0..1),
    ydimtop2=Slider(0.7, range=0..1),
    heightbase=multiplication_2,
    heighttop=addition_3,
    radius=cluster_3)  # -> flatten(bldg_2)
translations = Translations(geo=cluster_2, pt=pt)
flatten = FlattenTree(Tree=bldg_type_box, Path="0")
flatten_2 = FlattenTree(Tree=bldg_type_courtyard, Path="1")
flatten_3 = FlattenTree(Tree=bldg_type_l_c_o, Path="3")
flatten_4 = FlattenTree(Tree=bldg_type_towerbase, Path="2")
random_4 = Random(Range=Domain(0, 1), Number=lng, Seed=2)
dom_8 = ConstructDomain(DomainStart=0, DomainEnd=expr("x-1", lng))
remap_9 = RemapNumbers(Value=random_4, Source=Domain(0, 1), Target=dom_8)  # -> Mapped, Clipped
int_3 = Integer(remap_9.Mapped)
item = TreeItem(Tree=[flatten_4, flatten_3, flatten_2, flatten], Path=int, Index=int_3, Wrap=False)
randomflip = RandomFlip(G=item, L=translations)
move_2 = Move(Geometry=randomflip, Motion=translations)  # -> Geometry, Transform
cluster_4 = Cluster_3(bldg=move_2.Geometry, hrandlower=hrandlower_2, hrandseed=hrandseed_2)
rad = Radians(Degrees=rotation_2)
rotate = Rotate(Geometry=cluster_4, Angle=rad, Plane=PlaneXY(0, 0, 0))  # -> Geometry, Transform
cluster_5 = Cluster_4(R_2=lng, S_2=number_slider, R="25", S=addition)
cull_i = CullIndex(List=rotate.Geometry, Indices=cluster_5, Wrap=True)
mesh_join = MeshJoin(Meshes=cull_i)
concat = Concatenate(FragmentA="Z:\\\\SprawlGAN_2\Case", FragmentC=number_slider, JoinSeparator="_")
panel_2 = Panel(concat)
entwine = Entwine(Branch00=mesh_join, Branch01="0", Branch02="0", Branch03=panel_2, FlattenInputs=True)
data_3 = Data(entwine)

# ==== cluster RectangleGen
O = ClusterInput()
num = ClusterInput()
num_2 = ClusterInput()
xy = XYPlane(Origin=O)
num_3 = Number(num)
num_4 = Number(num_2)
neg = Negative(Value=num_4)
neg_2 = Negative(Value=num_3)
dom = ConstructDomain(DomainStart=num_4, DomainEnd=neg)
dom_2 = ConstructDomain(DomainStart=num_3, DomainEnd=neg_2)
rectangle = Rectangle(Plane=xy, XSize=dom, YSize=dom_2, Radius=0)  # -> Rectangle, Length
R = ClusterOutput(rectangle.Rectangle)

# ==== cluster CopyGen
blkdim = ClusterInput()
streetdim = ClusterInput()
edgedim = ClusterInput()
blkdim_2 = Number(blkdim)
streetdim_2 = Number(streetdim)
edgedim_2 = Number(edgedim)
multiplication = Multiplication(A=edgedim_2, B="2")
addition = Addition(A=multiplication, B=streetdim_2)
division = Division(A=blkdim_2, B=addition)
round = Round(Number=division)  # -> Nearest, Floor, Ceiling
series = Series(Start=addition, Step=addition, Count=round.Ceiling)
neg = Negative(Value=series)
merge = Merge(Data1=series, Data2=neg)
trans = Number(merge)
trans_2 = ClusterOutput(trans)

# ==== cluster Cluster
xdir = ClusterInput()
rectbase = ClusterInput()
ydir = ClusterInput()
xdir_2 = Vector(xdir)
rectbase_2 = Geometry(rectbase)
ydir_2 = Vector(ydir)
move = Move(Geometry=rectbase_2, Motion=xdir_2)  # -> Geometry, Transform
merge = Merge(Data1=rectbase_2, Data2=move.Geometry)  # -> flatten(Result)
geo = Geometry(graft(merge))
move_2 = Move(Geometry=geo, Motion=ydir_2)  # -> flatten(Geometry), Transform
merge_2 = Merge(Data1=merge, Data2=move_2.Geometry)  # -> flatten(Result)
grid = Geometry(merge_2)
grid_2 = ClusterOutput(grid)

# ==== cluster BLDGTypeBox
ydim = ClusterInput()
xdim = ClusterInput()
origin = ClusterInput()
radius = ClusterInput()
height = ClusterInput()
ydim_2 = Number(ydim)
xdim_2 = Number(xdim)
origin_2 = Point(origin)
height_2 = Number(height)
radius_2 = Number(radius)
neg = Negative(Value=xdim_2)
neg_2 = Negative(Value=ydim_2)
min = Minimum(A=xdim_2, B=ydim_2)
xy = XYPlane(Origin=origin_2)
dom = ConstructDomain(DomainStart=xdim_2, DomainEnd=neg)
dom_2 = ConstructDomain(DomainStart=ydim_2, DomainEnd=neg_2)
multiplication = Multiplication(A=min, B=radius_2)
rectangle = Rectangle(Plane=xy, XSize=dom, YSize=dom_2, Radius=multiplication)  # -> Rectangle, Length
Z = UnitZ(Factor=height_2)
extr = Extrude(Base=rectangle.Rectangle, Direction=Z)
cap = CapHoles(Brep=extr)
bldg = Brep(cap)
bldg_2 = ClusterOutput(bldg)

# ==== cluster Translations
geo = ClusterInput()
pt = ClusterInput()
geo_2 = Geometry(geo)
pt_2 = Point(pt)
area = Area(Geometry=geo_2)  # -> Area, Centroid
subtraction = Subtraction(A=pt_2, B=area.Centroid)
R = ClusterOutput(subtraction)

# ==== cluster BLDGTypeCourtyard
ydim = ClusterInput()
xdim = ClusterInput()
height = ClusterInput()
depth = ClusterInput()
origin = ClusterInput()
radius = ClusterInput()
min_courtyard_width = Panel("3")
ydim_2 = Number(ydim)
xdim_2 = Number(xdim)
height_2 = Number(height)
depth_2 = Number(depth)
origin_2 = Point(origin)
radius_2 = Number(radius)
neg = Negative(Value=xdim_2)
neg_2 = Negative(Value=ydim_2)
min = Minimum(A=xdim_2, B=ydim_2)
xy = XYPlane(Origin=origin_2)
dom = ConstructDomain(DomainStart=xdim_2, DomainEnd=neg)
dom_2 = ConstructDomain(DomainStart=ydim_2, DomainEnd=neg_2)
dim_check = CSharpScript(x=xdim_2, y=ydim_2, z=depth_2, u=min_courtyard_width)  # -> out, A; inputs x: Double, y: Double, z: Double, u: Double
# ---------- dim_check: C# ----------
    double XX = (2.0 * x) - (2.0 * z);
    double YY = (2.0 * y) - (2.0 * z);

    if(XX > u && YY > u) {A = true;}
    else{A = false;}
# ---------- end dim_check ----------
neg_3 = Negative(Value=depth_2)
multiplication = Multiplication(A=min, B=radius_2)
rectangle = Rectangle(Plane=xy, XSize=dom, YSize=dom_2, Radius=multiplication)  # -> Rectangle, Length
offset = OffsetCurve(Curve=rectangle.Rectangle, Distance=neg_3, Corners=1)
data = Data(graft(rectangle.Rectangle))
gate = StreamGate(Stream=offset, Gate=dim_check.A)  # -> Target0, Target1
simplify = SimplifyTree(Tree=data, Front=False)
simplify_2 = SimplifyTree(Tree=gate.Target1, Front=False)
Z = UnitZ(Factor=height_2)  # -> graft(UnitVector)
merge = Merge(Data1=simplify, Data2=simplify_2)
number_slider = Slider(17, range=0..20)
simplify_3 = SimplifyTree(Tree=Z, Front=False)
boundary = BoundarySurfaces(Edges=merge)
extr = Extrude(Base=boundary, Direction=simplify_3)
item = ListItem(List=boundary, Index=number_slider, Wrap=True)
branch = TreeBranch(Tree=extr, Path=number_slider, MaintainPaths=True)
cap = CapHoles(Brep=extr)
bldg = Brep(cap)
B = ClusterOutput(cap)

# ==== cluster BLDGTypeTowerBase
origin = ClusterInput()
xdim = ClusterInput()
ydim = ClusterInput()
xdimtop2 = ClusterInput()
ydimtop2 = ClusterInput()
xdimtop1 = ClusterInput()
ydimtop1 = ClusterInput()
radius = ClusterInput()
heightbase = ClusterInput()
heighttop = ClusterInput()
origin_2 = Point(origin)
xdim_2 = Number(xdim)
ydim_2 = Number(ydim)
xdimtop2_2 = Number(xdimtop2)
ydimtop2_2 = Number(ydimtop2)
radius_2 = Number(graft(radius))
xdimtop1_2 = Number(xdimtop1)
ydimtop1_2 = Number(ydimtop1)
heightbase_2 = Number(graft(heightbase))
heighttop_2 = Number(graft(heighttop))
neg = Negative(Value=xdim_2)
neg_2 = Negative(Value=ydim_2)
multiplication = Multiplication(A=xdimtop1_2, B=xdim_2)
multiplication_2 = Multiplication(A=xdimtop2_2, B=neg)
multiplication_3 = Multiplication(A=ydimtop1_2, B=ydim_2)
multiplication_4 = Multiplication(A=ydimtop2_2, B=neg_2)
xy = XYPlane(Origin=origin_2)
dom = ConstructDomain(DomainStart=xdim_2, DomainEnd=neg)
dom_2 = ConstructDomain(DomainStart=ydim_2, DomainEnd=neg_2)
panel = Panel("0.2")
min = Minimum(A=xdim_2, B=xdim_2)
panel_2 = Panel("5")
dom_3 = ConstructDomain(DomainStart=multiplication_3, DomainEnd=multiplication_4)
dom_4 = ConstructDomain(DomainStart=multiplication, DomainEnd=multiplication_2)
multiplication_5 = Multiplication(A=min, B=radius_2)
rectangle = Rectangle(Plane=xy, XSize=dom_4, YSize=dom_3, Radius=multiplication_5)  # -> Rectangle, Length
rectangle_2 = Rectangle(Plane=xy, XSize=dom, YSize=dom_2, Radius=multiplication_5)  # -> Rectangle, Length
Z = UnitZ(Factor=heightbase_2)
move = Move(Geometry=rectangle.Rectangle, Motion=Z)  # -> Geometry, Transform
Z_2 = UnitZ(Factor=heightbase_2)
Z_3 = UnitZ(Factor=heighttop_2)
extr = Extrude(Base=rectangle_2.Rectangle, Direction=Z_2)
extr_2 = Extrude(Base=move.Geometry, Direction=Z_3)
cap = CapHoles(Brep=extr)
cap_2 = CapHoles(Brep=extr_2)
simplify = SimplifyTree(Tree=cap_2, Front=False)
simplify_2 = SimplifyTree(Tree=cap, Front=False)
sunion = SolidUnion(Breps=[simplify, simplify_2])
bldg = Brep(sunion)
bldg_2 = ClusterOutput(bldg)

# ==== cluster RandomFlip
L = ClusterInput()
lng = ListLength(List=L)
xz = XZPlane(Origin=Point(0, 0, 0))
yz = YZPlane(Origin=Point(0, 0, 0))
repeat = RepeatData(Data=xz, Length=lng)
repeat_2 = RepeatData(Data=yz, Length=lng)
random = Random(Range=Domain(0, 1), Number=lng, Seed=2)
round = Round(Number=random)  # -> Nearest, Floor, Ceiling
G = ClusterInput()
int = Integer(round.Nearest)
p_n_c = PickNChoose(Pattern=int, Stream0=repeat, Stream1=repeat_2)
mirror = Mirror(Geometry=G, Plane=p_n_c)  # -> Geometry, Transform
G_2 = ClusterOutput(mirror.Geometry)

# ==== cluster BLDGTypeLCO
xdim = ClusterInput()
origin = ClusterInput()
ydim = ClusterInput()
xdim2 = ClusterInput()
ydim2 = ClusterInput()
xshift = ClusterInput()
yshift = ClusterInput()
xdim_2 = Number(xdim)
origin_2 = Point(origin)
ydim_2 = Number(ydim)
radius = ClusterInput()
heigh = ClusterInput()
xdim2_2 = Number(xdim2)
ydim2_2 = Number(ydim2)
xshift_2 = Number(xshift)
yshift_2 = Number(yshift)
radius_2 = Number(radius)
heigh_2 = Number(heigh)
neg = Negative(Value=xdim_2)
neg_2 = Negative(Value=ydim_2)
subtraction = Subtraction(A=xdim_2, B="10")
subtraction_2 = Subtraction(A=ydim_2, B="10")
xy = XYPlane(Origin=origin_2)
dom = ConstructDomain(DomainStart=xdim_2, DomainEnd=neg)
dom_2 = ConstructDomain(DomainStart=ydim_2, DomainEnd=neg_2)
dom_3 = ConstructDomain(DomainStart="10", DomainEnd=subtraction_2)
dom_4 = ConstructDomain(DomainStart="10", DomainEnd=subtraction)
min = Minimum(A=xdim_2, B=xdim_2)
multiplication = Multiplication(A=min, B=radius_2)
remap = RemapNumbers(Value=xdim2_2, Source=Domain(0, 1), Target=dom_4)  # -> Mapped, Clipped
subtraction_3 = Subtraction(A=xdim_2, B=remap.Mapped)
remap_2 = RemapNumbers(Value=ydim2_2, Source=Domain(0, 1), Target=dom_3)  # -> Mapped, Clipped
subtraction_4 = Subtraction(A=ydim_2, B=remap_2.Mapped)
neg_3 = Negative(Value=subtraction_4)
neg_4 = Negative(Value=subtraction_3)
neg_5 = Negative(Value=remap_2.Mapped)
neg_6 = Negative(Value=remap.Mapped)
dom_5 = ConstructDomain(DomainStart=subtraction_4, DomainEnd=neg_3)
dom_6 = ConstructDomain(DomainStart=subtraction_3, DomainEnd=neg_4)
rectangle = Rectangle(Plane=xy, XSize=dom, YSize=dom_2, Radius=multiplication)  # -> Rectangle, Length
dom_7 = ConstructDomain(DomainStart=remap.Mapped, DomainEnd=neg_6)
dom_8 = ConstructDomain(DomainStart=remap_2.Mapped, DomainEnd=neg_5)
remap_3 = RemapNumbers(Value=xshift_2, Source=Domain(0, 1), Target=dom_6)  # -> Mapped, Clipped
remap_4 = RemapNumbers(Value=yshift_2, Source=Domain(0, 1), Target=dom_8)  # -> Mapped, Clipped
rectangle_2 = Rectangle(Plane=xy, XSize=dom_7, YSize=dom_8, Radius=0)  # -> Rectangle, Length
Y = UnitY(Factor=remap_4.Mapped)
X = UnitX(Factor=remap_3.Mapped)
move = Move(Geometry=rectangle_2.Rectangle, Motion=X)  # -> Geometry, Transform
move_2 = Move(Geometry=move.Geometry, Motion=Y)  # -> Geometry, Transform
rdiff = RegionDifference(CurvesA=rectangle.Rectangle, CurvesB=move_2.Geometry)
Z = UnitZ(Factor=heigh_2)
boundary = BoundarySurfaces(Edges=rdiff)
extr = Extrude(Base=boundary, Direction=Z)
cap = CapHoles(Brep=extr)
bldg = Brep(cap)
bldg_2 = ClusterOutput(bldg)

# ==== cluster Cluster_2
blkdim = ClusterInput()
streetdim = ClusterInput()
edgedim = ClusterInput()
blkdim_2 = Number(blkdim)
streetdim_2 = Number(streetdim)
edgedim_2 = Number(edgedim)
multiplication = Multiplication(A=edgedim_2, B="2")
addition = Addition(A=multiplication, B=streetdim_2)
division = Division(A=blkdim_2, B=addition)
round = Round(Number=division)  # -> Nearest, Floor, Ceiling
subtraction = Subtraction(A=round.Ceiling, B="1")
series = Series(Start=0, Step=1, Count=subtraction)
series_2 = Series(Start=addition, Step=addition, Count=round.Ceiling)
neg = Negative(Value=series_2)
item = ListItem(List=series_2, Index=series, Wrap=True)
merge = Merge(Data1=item, Data2=neg)
trans = Number(merge)
trans_2 = ClusterOutput(trans)

# ==== cluster Cluster_3
hrandlower = ClusterInput()
hrandseed = ClusterInput()
bldg = ClusterInput()
hrandlower_2 = Number(hrandlower)
hrandseed_2 = Number(hrandseed)
bldg_2 = Geometry(bldg)
panel = Panel("0.5")
dom = ConstructDomain(DomainStart=hrandlower_2, DomainEnd="1")
floorheight = Panel("3.5")
lng = ListLength(List=bldg_2)
random = Random(Range=dom, Number=lng, Seed=hrandseed_2)
round = Round()  # -> Nearest, Floor, Ceiling
multiplication = Multiplication(A=round.Nearest, B=floorheight)
scale_nu = ScaleNU(Geometry=bldg_2, Plane=PlaneXY(0, 0, 0), ScaleX=1, ScaleY=1, ScaleZ=random)  # -> Geometry, Transform
bldg_3 = Geometry(scale_nu.Geometry)
bldg_4 = ClusterOutput(bldg_3)

# ==== cluster Cluster_4
R = ClusterInput()
S = ClusterInput()
random = Random(Range=R, Number=1, Seed=S)
R_2 = ClusterInput()
S_2 = ClusterInput()
random_2 = Random(Range=R_2, Number=random, Seed=S_2)
int = Integer(random_2)
int_2 = ClusterOutput(int)

# ==== cluster Cluster_5
random = Random(Range="0 to 0.8", Number="10000", Seed=2)
C = ClusterInput()
graph = GraphMapper(random, x0=1, x1=0, y0=1, y1=0, container_name="Bezier", cpx=[0, 0.4111785889, 1, 1], cpy=[1, 0.7862051725, 1, 0])
div = DivideDomain(Domain="0 to 0.8", Count=C)
inc = Includes(Value=graph, Domain=graft(div))  # -> Includes, Deviation
dedomain = DeconstructDomain(Domain=div)  # -> Start, End
ma = MassAddition(Input=inc.Includes)  # -> flatten(Result), PartialResults
expression = Expression(x=dedomain.Start, y=dedomain.End, Expression="(x+y)/2")
bnd = Bounds(Numbers=ma.Result)
dedomain_2 = DeconstructDomain(Domain=bnd)  # -> Start, End
division = Division(A=ma.Result, B=dedomain_2.End)
pt = ConstructPoint(XCoordinate=expression, YCoordinate=division, ZCoordinate=0)
R = ClusterOutput(division)
pline = PolyLine(Vertices=pt, Closed=False)
